% Simulink data dictionary ButtonLogicData.sldd

ECU_SL_Status = Simulink.Parameter(0, DataType="uint8")
ECU_CC_Feature = Simulink.Parameter(0, DataType="uint8")
CCU_RCM_Feature = Simulink.Parameter(0, DataType="uint8")
CCU_RCM_Ready_Status = Simulink.Parameter(0, DataType="uint8")
ECU_SL_LED = Simulink.Parameter(0, DataType="uint8")
ECU_SL_Feature = Simulink.Parameter(0, DataType="uint8")
CCU_Status = Simulink.Parameter(eCCUStatus.installed, DataType="Enum: eCCUStatus")
CCU_TbT_Navigation_Feature = Simulink.Parameter(0, DataType="uint8")
CCU_Music_Feature = Simulink.Parameter(0, DataType="uint8")
heatingGrip = Simulink.Parameter(0, DataType="uint8")
BLU_MaxRndTimeLoopLim = Simulink.Parameter(98, DataType="uint8")
ECU_Quickshifter_Feature = Simulink.Parameter(0, DataType="uint8")
BLU_LngDwnDtcMax_Tms = Simulink.Parameter(5000, DataType="uint16")
BLU_UpDtctMin_Tms = Simulink.Parameter(50, DataType="uint16")
BLU_UpDtctMax_Tms = Simulink.Parameter(2000, DataType="uint16")
BLU_LngUpDtctMin_Tms = Simulink.Parameter(3000, DataType="uint16")
BLU_LngUpDtctMax_Tms = Simulink.Parameter(5000, DataType="uint16")
BLU_LngDwnDtctMin_Tms = Simulink.Parameter(3000, DataType="uint16")
BLU_LngDwnDtctMax_Tms = Simulink.Parameter(5000, DataType="uint16")
BLU_DwnDtctMin_Tms = Simulink.Parameter(50, DataType="uint16")
BLU_DwnDtctMax_Tms = Simulink.Parameter(2000, DataType="uint16")
BLU_LngSetDtctMin_Tms = Simulink.Parameter(3000, DataType="uint16")
BLU_LngSetDtctMax_Tms = Simulink.Parameter(5000, DataType="uint16")
BLU_SetDtctMin_Tms = Simulink.Parameter(50, DataType="uint16")
BLU_SetDtctMax_Tms = Simulink.Parameter(2000, DataType="uint16")
BLU_LngExitDtctMin_Tms = Simulink.Parameter(3000, DataType="uint16")
BLU_LngExitDtctMax_Tms = Simulink.Parameter(5000, DataType="uint16")
BLU_ExitDtctMin_Tms = Simulink.Parameter(50, DataType="uint16")
BLU_ExitDtctMax_Tms = Simulink.Parameter(2000, DataType="uint16")
DASH_SL_Switch = Simulink.Parameter(0, DataType="uint8")
Heated_Grips = Simulink.Parameter(0, DataType="uint8")
BLU_CCDtctMax_Tms = Simulink.Parameter(2000, DataType="uint16")
BLU_CCDtctMin_Tms = Simulink.Parameter(50, DataType="uint16")
BLU_CCSetDtctMax_Tms = Simulink.Parameter(2000, DataType="uint16")
BLU_CCSetDtctMin_Tms = Simulink.Parameter(50, DataType="uint16")
BLU_ResDtctMax_Tms = Simulink.Parameter(2000, DataType="uint16")
BLU_ResDtctMin_Tms = Simulink.Parameter(50, DataType="uint16")
CCU_BT_Status = Simulink.Parameter(0, DataType="uint8")
ABS_ABS_Mode_Response = Simulink.Parameter(eABSMode.road, DataType="Enum: eABSMode")
ABS_Launch_Control_Feature = Simulink.Parameter(1, DataType="uint16")
ABS_Mode_Feature = Simulink.Parameter(1, DataType="uint16")
Sig = Simulink.Signal()
ABS_TC_MTC_Mode_Feature = Simulink.Parameter(eTCMode.TCMode_TC, DataType="Enum: eTCMode")
ABS_TC_Mode_Response = Simulink.Parameter(0, DataType="uint16")
ECU_Drive_Mode_Response = Simulink.Parameter(0, DataType="uint16")